# Dynamo graph Program XLS to 3d.dyn (Dynamo 0.9.0.3067)

# group: Instatiate the Family
family_types = FamilyTypes("00 Programming Block:00 Programming Block")
levels = Levels("LEVEL 1")

# group: Load Excel File
file_path = Filename("C:\Users\jszczesniak\Desktop\Design Tech Projects\Dynamo\Program Stacking and Blocking\Sample Program.xlsx")
fromPath = FileObject(file_path)  # "File.FromPath"
code_block = CodeBlock { "Sheet1"; }
readFromFile = Excel.ReadFromFile(file=fromPath, sheetName=code_block)

# note: Drop Headers
restOfItems = List.RestOfItems(readFromFile)

# group: Duplicate rows of program as required to meet the required COUNT of each type
ofRepeatedItem = List.OfRepeatedItem()
code_block_2 = CodeBlock { 4; }
# note: Extract COUNT for each program type required
getItemAtIndex = List.GetItemAtIndex(index=code_block_2)
map = List.Map(list=restOfItems, f_x=getItemAtIndex)
combine = List.Combine(ofRepeatedItem, restOfItems, map)
code_block_3 = CodeBlock { 1; }

# group: RAW DATA
# note: Organized by row
flatten = List.Flatten(list=combine, amt=code_block_3)
# note: Organized by column
transpose = List.Transpose(flatten)

# group: Group entries by department, then assign each entry a UID - MASTER LIST ORGANIZATION FOR SORTING
code_block_4 = CodeBlock { 0; }
code_block_5 = CodeBlock { 2; }
# note: DEPARTMENT field
getItemAtIndex_2 = List.GetItemAtIndex(list=transpose, index=code_block_5)
countOccurences = Custom[List.CountOccurences](list=getItemAtIndex_2)  # Counts the number of occurences of each unique element in a given list
lunchbox_mass_addition = Custom[LunchBox Mass Addition](Numbers=countOccurences.Count)  # Returns the total value of a list of numbers.
addItemToFront = List.AddItemToFront(item=code_block_4, list=lunchbox_mass_addition.Partials)
code_block_6 = CodeBlock(x=lunchbox_mass_addition.Partials) { x-1; }
code_block_7 = CodeBlock(x=addItemToFront, y=code_block_6) { x..y; }

# group: Isolate each column and sort by DEPARTMENT
code_block_8 = CodeBlock(a=transpose) { a[0]; a[1]; a[2]; a[3]; a[4]; a[5]; a[6]; a[7]; a[8]; a[9]; a[10]; }
targetWidth = List.GetItemAtIndex(list=code_block_8.out8, index=code_block_7)
targetLength = List.GetItemAtIndex(list=code_block_8.out7, index=code_block_7)
targetHeight = List.GetItemAtIndex(list=code_block_8.out6, index=code_block_7)
programColor = List.GetItemAtIndex(list=code_block_8.out9, index=code_block_7)
targetArea = List.GetItemAtIndex(list=code_block_8.out3, index=code_block_7)
roomNames = List.GetItemAtIndex(list=code_block_8.out0, index=code_block_7)
spaceType = List.GetItemAtIndex(list=code_block_8.out1, index=code_block_7)
department = List.GetItemAtIndex(list=code_block_8.out2, index=code_block_7)
programNotes = List.GetItemAtIndex(list=code_block_8.out10, index=code_block_7)

# group: Add each width to the one preceding it in the list to determine minimum X-values
lunchbox_mass_addition_2 = Custom[LunchBox Mass Addition]()
map_2 = List.Map(list=targetWidth, f_x=lunchbox_mass_addition_2.Partials)

# group: Add 0 to the start of each list (starts each DEPARTMENT on the Y-axis), then drop last item in the list to keep lenths the same
code_block_9 = CodeBlock { 0; }
addItemToFront_2 = List.AddItemToFront(item=code_block_9)
map_3 = List.Map(list=map_2, f_x=addItemToFront_2)
code_block_10 = CodeBlock(l1=map_3) { List.DropItems(l1,-1); }

# note: SPACING BETWEEN BLOCKS
spacing_slider = IntegerSlider(10, range=1..10 step 1)

# group: Create a spacing to add to each value in the list. Number of items in the list * desired spacing between objects
count = Count()
map_4 = List.Map(list=map_2, f_x=count)
# note: Subtract the count by 1 since we are starting the index at 0.
code_block_11 = CodeBlock(count=map_4) { 0..count-1; }
code_block_12 = CodeBlock(count=code_block_11, multiplier=spacing_slider) { count*multiplier; }

code_block_13 = CodeBlock(width=code_block_10, spacing=code_block_12) { width+spacing; }

# group: Find the maximum LENGTH in each department, then sequentially add these to create the Y-axis spacing
maximumItem = List.MaximumItem(targetLength)
lunchbox_mass_addition_3 = Custom[LunchBox Mass Addition](Numbers=maximumItem)

# group: Create a spacing to add to each value in the list.
count_2 = Count(lunchbox_mass_addition_3.Partials)
code_block_14 = CodeBlock(z=count_2) { 0..z-1; }
code_block_15 = CodeBlock(count=code_block_14, multiplier=spacing_slider) { count*multiplier; }

# group: Add 0 to the start of each list (starts the vectors on the X axis), then drop the last item in the list to keep the length the same.
code_block_16 = CodeBlock { 0; }
addItemToFront_3 = List.AddItemToFront(item=code_block_16, list=lunchbox_mass_addition_3.Partials)
code_block_17 = CodeBlock(l1=addItemToFront_3) { List.DropItems(l1,-1); }

code_block_18 = CodeBlock(spacing=code_block_15, length=code_block_17) { spacing+length; }

# group: Move points created on the X-axis, by the Y-VECTOR based on Department
add = Point.Add()
# note: Create points in X-axis
byCoordinates = Point.ByCoordinates(x=code_block_13)
# note: Create Y-VECTOR
byCoordinates_2 = Vector.ByCoordinates(y=code_block_18)
combine_2 = List.Combine(add, byCoordinates, byCoordinates_2)

# group: Modify the family Parameters to match Program Data
byPointAndLevel = FamilyInstance.ByPointAndLevel(familyType=family_types, point=combine_2, level=levels)
code_block_19 = CodeBlock { "Height"; "Length"; "Width"; }
setParameterByName = Element.SetParameterByName(element=byPointAndLevel, parameterName=code_block_19.out0, value=targetHeight)
setParameterByName_2 = Element.SetParameterByName(element=byPointAndLevel, parameterName=code_block_19.out2, value=targetWidth)
setParameterByName_3 = Element.SetParameterByName(element=byPointAndLevel, parameterName=code_block_19.out1, value=targetLength)
code_block_20 = CodeBlock { "Program Color"; }
code_block_21 = CodeBlock { "Yellow"; "Orange"; "Purple"; "Blue"; "Gray"; }
create = List.Create(code_block_21.out0, code_block_21.out1, code_block_21.out2, code_block_21.out3, code_block_21.out4)
code_block_22 = CodeBlock()
# ---------- code_block_22.designscript (6 lines) ----------
Yellow="+00 Programming - Orange 01";
Orange="+00 Programming - Orange 02";
Purple="+00 Programming - Blue 01";
Blue="+00 Programming - Blue 03";
Gray="+00 Programming - Gray 03";
colors={Yellow,Orange,Purple,Blue,Gray};
# ----------------------------------------
matchWithKeyValues = Custom[List.MatchWithKeyValues](keys=create, values=code_block_22.colors)  # Matches a list with a given set of keys and returns the values corresponding to the keys
map_5 = List.Map(list=programColor, f_x=matchWithKeyValues)
byName = Material.ByName(map_5)
setParameterByName_4 = Element.SetParameterByName(element=byPointAndLevel, parameterName=code_block_20, value=byName)
code_block_23 = CodeBlock { "Target Area"; }
setParameterByName_5 = Element.SetParameterByName(element=byPointAndLevel, parameterName=code_block_23, value=targetArea)
code_block_24 = CodeBlock { "Room Name"; "Space Type"; "Department"; }
setParameterByName_6 = Element.SetParameterByName(element=byPointAndLevel, parameterName=code_block_24.out0, value=roomNames)
setParameterByName_7 = Element.SetParameterByName(element=byPointAndLevel, parameterName=code_block_24.out1, value=spaceType)
setParameterByName_8 = Element.SetParameterByName(element=byPointAndLevel, parameterName=code_block_24.out2, value=department)
code_block_25 = CodeBlock { "Comments"; }
setParameterByName_9 = Element.SetParameterByName(element=byPointAndLevel, parameterName=code_block_25, value=programNotes)
